# Grasshopper definition 180211_rigids_with_springs.gh (Grasshopper 0.9.76)
# plug-ins: MeshEdit Components, FlexHopper

number_slider = Slider(200, range=0..1000)
number_slider_2 = Slider(1, range=1..5)
dom = ConstructDomain(DomainStart=expr("-x", number_slider), DomainEnd=number_slider)
mbox = MeshBox(
    Base={Plane=PlaneXY(0, 0, 0), X=Domain(-10, 10), Y=Domain(-10, 10), Z=Domain(-10, 10)},
    XCount=number_slider_2,
    YCount=number_slider_2,
    ZCount=number_slider_2)
random = Random(Range=Domain(0, 1), Number=1, Seed=2)
random_2 = Random(Range=dom, Number=expr("x*6", Slider(17, range=1..50)), Seed=2)
tri = Triangulate(Mesh=mbox)  # -> Mesh, Count
partition = PartitionList(List=random_2, Size=6)
item = ListItem(List=partition, Index=0, Wrap=True)  # -> Item, Item1, Item2, Item3, Item4, Item5
abs = Absolute(Value=item.Item2)
pt = ConstructPoint(XCoordinate=item.Item, YCoordinate=item.Item1, ZCoordinate=expr("x*2", abs))
vec = VectorXYZ(XComponent=item.Item3, YComponent=item.Item4, ZComponent=item.Item5)  # -> Vector, Length
pl = PlaneNormal(Origin=pt, ZAxis=vec.Vector)
orient = Orient(Geometry=tri.Mesh, Source=PlaneXY(0, 0, 0), Target=pl)  # -> flatten(Geometry), Transform
weldvertices = MeshWeldVertices(Mesh=orient.Geometry, Tolerance=0.01)  # -> RuntimeMessage, Mesh
lng = ListLength(List=weldvertices.Mesh)
rigid = RigidFromMesh(RigidBodyMesh=weldvertices.Mesh, Velocities=Vector(0, 0, 0), Mass=1, Stiffness=1, GroupIndex="4")
panel = Panel(rigid)
